# Grasshopper definition CompositeTestPrompt.gh (Grasshopper 1.0.8)

trigger = Trigger(Interval=500, TimerInterval=500, Target=composite_text_prompt)
composite_text_prompt = Python3Script()  # -> a, b
# ---------- composite_text_prompt: Python ----------
"""GH Python – outputs: raw  (a), refined (b)"""

import json, urllib.request

API = ("https://script.google.com/macros/s/"
       "AKfycbyIC9mQxDWx7Daec_9yqdtUo6fjF2WzMM1dO1hZqfhKnPi1CB7bXyxoqo0RMcCC9BFb"
       "/exec?latest=1")   # << the URL that just printed the JSON

try:
    with urllib.request.urlopen(API, timeout=5) as r:
        payload = json.loads(r.read().decode())
        raw     = payload.get("raw", "")
        refined = payload.get("refined", "")
except Exception as e:
    raw = refined = f"ERR: {e}"


a = raw        # plug to panel for the raw concatenation
b = refined    # plug to panel for the Sora-ready prompt
# ---------- end composite_text_prompt ----------
panel = Panel(composite_text_prompt.b)
panel_2 = Panel(composite_text_prompt.a)
